# Grasshopper definition Foot Traffic Analysis Tool.gh (Grasshopper 1.0.7)
# plug-ins: Human

# ---- group: Example Controls
num_iteration_number = Number(Slider(79, range=0..79))

# ----
density_location = Panel("""0
1
2""")
series = Series(Start="0", Step="1", Count="5")
series_2 = Series(Start="1", Step="1", Count="4")
crossref = CrossReference(ListA=density_location, ListB=series, ListC=series_2, CrossMode=1)  # -> graft(ListA), graft(ListB), graft(ListC)
merge = Merge(Data1=crossref.ListA, Data2=crossref.ListB, Data3=crossref.ListC)
join = TextJoin(Text=merge, Join=",")  # -> flatten(Result)
item = ListItem(List=join, Index=num_iteration_number, Wrap=True)
split = TextSplit(Text=item, Separators=",")
item_2 = ListItem(List=split, Index=0, Wrap=True)  # -> Item, Item1, Item2
int_density_location = Integer(item_2.Item)
parcel_width_domain = Panel("125 to 50")
crv_boundary = Curve(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)
street_size = Panel("""-35
35""")
crv_streets_3 = Curve([<curve referenced from the Rhino model> x8])
geo_corners = Geometry(<point referenced from the Rhino model>)
geo_center = Geometry(<point referenced from the Rhino model>)
geo_north = Geometry(<point referenced from the Rhino model>)
area = Area(Geometry=crv_boundary)  # -> Area, Centroid
blocks_and_parcels = BlocksAndParcels(
    crv_boundary=crv_boundary,
    crv_street_centerline=crv_streets_3,
    int_street_size=street_size,
    int_density_location=int_density_location,
    geo_center=geo_center,
    geo_north=geo_north,
    geo_corners=geo_corners,
    domain_parcel_width_domain=parcel_width_domain)  # -> srf_streets_3, srf_blocks_3, crv_parcels_2, geo_density_location_4
xy = XYPlane(Origin=area.Centroid)
medium_far_threshold = Panel("6")
project = Project(Geometry=blocks_and_parcels.crv_parcels_2, Plane=xy)  # -> Geometry, Transform
high_far_threshold = Panel("10")
int_density_distribution = Integer(item_2.Item1)
floor_to_floor_height = Panel("12")
average_far = Panel("8")
density_distribution = Panel("""0.1
0.3
0.5
0.7
0.9""")
geo_row_home = Geometry(<brep referenced from the Rhino model>)
geo_midrise = Geometry([<brep referenced from the Rhino model> x3])
geo_tower = Geometry([<brep referenced from the Rhino model> x3])
buildings = Buildings(
    crv_parcels=project.Geometry,
    geo_density_location=blocks_and_parcels.geo_density_location_4,
    num_avg_far=average_far,
    num_density_distribution=density_distribution,
    int_density_distribution_selection=int_density_distribution,
    num_medium_far_threshold=medium_far_threshold,
    num_medium_far_threshold_2=high_far_threshold,
    num_floor_to_floor_height=floor_to_floor_height,
    geo_row_home=geo_row_home,
    geo_midrise=geo_midrise,
    geo_tower=geo_tower)
crv_parcels = Curve(project.Geometry)
int_density_and_height_culling = Integer(item_2.Item2)
brep_buildings = Brep(buildings)
pt_build_plane = Point(xy)
air_rights_modification = AirRightsModification(
    brep_buildings=brep_buildings,
    pt_build_plane=pt_build_plane,
    int_density_and_height_culling=int_density_and_height_culling,
    crv_parcels=crv_parcels)  # -> brep_buildings_4, srf_parks_2

# ---- group: Foot Traffic Analysis Tool / Analysis Controls
num_threshold = Slider(250, range=0..1000)
num_color_sensitivity = Slider(285, range=1..1000)
offset_divisor = Slider(4, range=0..10)
height_divisor = Slider(6, range=0..10)
number_slider = Slider(1000, range=0..1000)
pt_destination_2 = Point(Point(3607.919013, 382.2580124, 85.66178627))
pt_destination_1 = Point(Point(4899.128918, -1364.061395, 85.66178627))
pt_destination_3 = Point(Point(5976.729621, 924.7742931, 85.66178627))

# ---- group: Foot Traffic Analysis Tool
foot_traffic_analysis_building_gen = FootTrafficAnalysisBuildingGen(
    crv_perimeter_road_analysis_area_bounds=crv_boundary,
    crv_roads=crv_streets_3,
    B_4=blocks_and_parcels.srf_streets_3,
    num_center_road_offset=street_size,
    B_3=blocks_and_parcels.srf_blocks_3,
    brep_buildings=air_rights_modification.brep_buildings_4,
    pt_destination_1=pt_destination_1,
    pt_destination_2=pt_destination_2,
    pt_destination_3=pt_destination_3,
    num_population=number_slider,
    num_population_threshold_for_high_traffi=num_threshold,
    num_analysis_color_sensitivity_upper_bou=num_color_sensitivity,
    B=offset_divisor,
    B_2=height_divisor)  # -> num_people_per_street_segment_above_thre_2, col_analysis_color_2, pt_point_to_display_people_number_for_se_2, O, num_per_street_foot_traffic_4, num_percentage_of_streets_above_threshol_2, R

# ---- group: Foot Traffic Analysis Tool / Outputs for Scout
num_all_ppss_scout = Number(foot_traffic_analysis_building_gen.num_per_street_foot_traffic_4)
num_above_threshold_scout = Number(foot_traffic_analysis_building_gen.num_percentage_of_streets_above_threshol_2)
brep_new_commercial_buildings = Brep(foot_traffic_analysis_building_gen.R)

# ---- group: Visualizations for Rhino
Z = UnitZ(Factor=Slider(50, range=0..100))
move = Move(Geometry=foot_traffic_analysis_building_gen.pt_point_to_display_people_number_for_se_2, Motion=Z)  # -> Geometry, Transform
preview = CustomPreview(Geometry=flatten(foot_traffic_analysis_building_gen.O), Material=foot_traffic_analysis_building_gen.col_analysis_color_2)
screentext = ScreenOrientedText(
    Text=foot_traffic_analysis_building_gen.num_people_per_street_segment_above_thre_2,
    Justification=5,
    Location=move.Geometry,
    SizeFactor=Slider(15, range=0..100),
    Color=ColourSwatch(SwatchColor=RGB(133, 0, 0)),
    Depth=0,
    Absolute=Toggle(True))

geo_context_bldgs_closed_breps = Geometry([<brep referenced from the Rhino model> x578])
swatch = ColourSwatch(SwatchColor=RGB(227, 216, 218))
srf_streets_outside_analysis_area = Surface([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])
srf_streets_inside_analysis_area = Surface([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])
geo_ground = Geometry(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)
preview_2 = CustomPreview(Geometry=geo_ground, Material=ColourSwatch(SwatchColor=RGB(166, 159, 159)))
preview_3 = CustomPreview(Geometry=srf_streets_inside_analysis_area, Material=ColourSwatch(SwatchColor=RGB(76, 76, 76)))
preview_4 = CustomPreview(Geometry=geo_context_bldgs_closed_breps, Material=swatch)
preview_5 = CustomPreview(Geometry=srf_streets_outside_analysis_area, Material=swatch)

brep_commercial_buildings = Brep(brep_new_commercial_buildings)
brep_residential_buildings = Brep(air_rights_modification.brep_buildings_4)
brep_parks = Brep(air_rights_modification.srf_parks_2)
preview_6 = CustomPreview(Geometry=brep_residential_buildings, Material=ColourSwatch(SwatchColor=RGB(242, 242, 242)))
preview_7 = CustomPreview(Geometry=brep_parks, Material=ColourSwatch(SwatchColor=RGB(59, 175, 92)))
preview_8 = CustomPreview(Geometry=brep_commercial_buildings, Material=ColourSwatch(SwatchColor=RGB(184, 183, 199)))

# ==== cluster BlocksAndParcels
crv_street_centerline = ClusterInput()
int_density_location = ClusterInput()
int_street_size = ClusterInput()
domain_parcel_width_domain = ClusterInput()
geo_corners = ClusterInput()
geo_center = ClusterInput()
geo_north = ClusterInput()
int_density_location_2 = Integer(int_density_location)
int_street_size_2 = Integer(int_street_size)
domain_parcel_width_domain_2 = Domain(domain_parcel_width_domain)
geo_corners_2 = Geometry(geo_corners)
geo_center_2 = Geometry(geo_center)
geo_north_2 = Geometry(geo_north)
filter = StreamFilter(Gate=int_density_location_2, Stream0=geo_center_2, Stream1=geo_north_2, Stream2=geo_corners_2)
crv_boundary = ClusterInput()
crv_boundary_2 = Curve(crv_boundary)
crv_street_centerline_2 = Curve(crv_street_centerline)
geo_density_location = Geometry(filter)
ext = ExtendCurve(Curve=crv_street_centerline_2, Type=0, Start="80", End="80")
crv_boundary_3 = Curve(crv_boundary_2)
int_street_size_3 = Integer(int_street_size_2)
offset = OffsetCurve(Curve=graft(ext), Distance=int_street_size_3, Plane=PlaneXY(0, 0, 0), Corners=1)  # -> simplify(Curve)
trim = TrimTree(Tree=offset, Depth=1)
loft = Loft(Curves=trim, Options={Adjust=False, Closed=False, LoftEnds=0, LoftSimp=0, LoftType=0, Rebuild=10, Refit=0.01})  # -> flatten(Loft)
srfsplit = SurfaceSplit(Surface=crv_boundary_3, Curves=loft)
area = Area(Geometry=srfsplit)  # -> Area, Centroid
pull = PullPoint(Point=area.Centroid, Geometry=loft, ClosestOnly=True)  # -> ClosestPoint, Distance
int = Integer(pull.Distance)
equals = Equality(FirstNumber=int, SecondNumber="0")  # -> Equality, Inequality
dispatch = Dispatch(List=srfsplit, DispatchPattern=equals.Equality)  # -> ListA, ListB
geo_density_location_2 = Geometry(geo_density_location)
srf_blocks = Surface(dispatch.ListB)
srf_streets = Surface(dispatch.ListA)
explode = Explode(Curve=srf_blocks, Recursive=True)  # -> Segments, Vertices
geo_density_location_3 = Geometry(geo_density_location_2)
reb = RebuildCurve(Curve=explode.Segments, Degree="1", Count=10, Tangents=False)
geo_density_location_4 = ClusterOutput(geo_density_location_3)
srf_blocks_2 = Surface(srf_blocks)
srf_streets_2 = Surface(srf_streets)
pull_2 = PullPoint(Point=explode.Vertices, Geometry=geo_density_location_2, ClosestOnly=True)  # -> ClosestPoint, Distance
srf_blocks_3 = ClusterOutput(srf_blocks_2)
srf_streets_3 = ClusterOutput(srf_streets_2)
join = JoinCurves(Curves=reb, Preserve=False)
sort = SortList(Keys=pull_2.Distance)  # -> Keys, ValuesA
item = ListItem(List=sort.Keys, Index=0, Wrap=True)  # -> flatten(Item)
domain_parcel_width_domain_3 = Domain(domain_parcel_width_domain_2)
bnd = Bounds(Numbers=item)
remap = RemapNumbers(Value=item, Source=bnd, Target=domain_parcel_width_domain_3)  # -> Mapped, Clipped
parcels = Parcels(Polygons=graft(join), ConnectionDistance=1, StreetOffset=0, PlotWidthThreshold=graft(remap.Mapped), Precision=100)
# Parcels
crv_parcels = Curve(graft(parcels))
crv_parcels_2 = ClusterOutput(crv_parcels)

# ==== cluster Buildings
int_density_distribution_selection = ClusterInput()
num_floor_to_floor_height = ClusterInput()
num_medium_far_threshold = ClusterInput()
num_medium_far_threshold_2 = ClusterInput()
num_density_distribution = ClusterInput()
num_avg_far = ClusterInput()
geo_row_home = ClusterInput()
geo_tower = ClusterInput()
geo_midrise = ClusterInput()
int_density_distribution_selection_2 = Integer(int_density_distribution_selection)
num_floor_to_floor_height_2 = Number(num_floor_to_floor_height)
num_medium_far_threshold_3 = Number(num_medium_far_threshold)
num_medium_far_threshold_4 = Number(num_medium_far_threshold_2)
num_density_distribution_2 = Number(num_density_distribution)
num_avg_far_2 = Number(num_avg_far)
geo_row_home_2 = Geometry(geo_row_home)
geo_tower_2 = Geometry(geo_tower)
geo_midrise_2 = Geometry(geo_midrise)
item = ListItem(List=num_density_distribution_2, Index=int_density_distribution_selection_2, Wrap=True)
num_density_distribution_3 = Number(item)
geo_density_location = ClusterInput()
crv_parcels = ClusterInput()
geo_density_location_2 = Geometry(geo_density_location)
crv_parcels_2 = Curve(crv_parcels)
item_2 = ListItem(List=flatten(crv_parcels_2), Index=0, Wrap=True)
num_density_distribution_4 = Number(num_density_distribution_3)
crv_parcels_3 = Curve(crv_parcels_2)
num_avg_far_3 = Number(num_avg_far_2)
explode = Explode(Curve=crv_parcels_3, Recursive=True)  # -> Segments, Vertices
pull = PullPoint(Point=explode.Vertices, Geometry=geo_density_location_2, ClosestOnly=True)  # -> ClosestPoint, Distance
addition = Addition(A=num_density_distribution_4, B="1")
subtraction = Subtraction(A="1", B=num_density_distribution_4)
sort = SortList(Keys=pull.Distance)  # -> Keys, ValuesA
multiplication = Multiplication(A=num_avg_far_3, B=addition)
multiplication_2 = Multiplication(A=num_avg_far_3, B=subtraction)
item_3 = ListItem(List=sort.Keys, Index=0, Wrap=True)
num_medium_far_threshold_5 = Number(num_medium_far_threshold_4)
num_medium_far_threshold_6 = Number(num_medium_far_threshold_3)
dom = ConstructDomain(DomainStart=multiplication, DomainEnd=multiplication_2)
bnd = Bounds(Numbers=flatten(item_3))
remap = RemapNumbers(Value=item_3, Source=bnd, Target=dom)  # -> simplify(Mapped), Clipped
srf_parcels = Surface(crv_parcels_2)
num_far = Number(remap.Mapped)
Z = UnitZ(Factor="100")
crv_parcels_4 = Curve(crv_parcels_3)
move = Move(Geometry=srf_parcels, Motion=Z)  # -> Geometry, Transform
area = Area(Geometry=crv_parcels_4)  # -> Area, Centroid
blendbox = BlendBox(SurfaceA=srf_parcels, DomainA=srf_parcels, SurfaceB=move.Geometry, DomainB=move.Geometry)
multiplication_3 = Multiplication(A=area.Area, B=num_far)
num_gfa = Number(multiplication_3)
num_medium_far_threshold_7 = Number(num_medium_far_threshold_6)
num_far_2 = Number(num_far)
num_hight_far_threshold = Number(num_medium_far_threshold_5)
smaller = SmallerThan(FirstNumber=num_far_2, SecondNumber=num_medium_far_threshold_7)  # -> SmallerThan, OrEqualTo
smaller_2 = SmallerThan(FirstNumber=num_far_2, SecondNumber=num_hight_far_threshold)  # -> SmallerThan, OrEqualTo
dispatch = Dispatch(List=blendbox, DispatchPattern=smaller.SmallerThan)  # -> ALowDensityBox, ListB
dispatch_2 = Dispatch(List=num_gfa, DispatchPattern=smaller.SmallerThan)  # -> ListA, ListB
geo_row_home_3 = Geometry(geo_row_home_2)
geo_midrise_3 = Geometry(geo_midrise_2)
geo_tower_3 = Geometry(geo_tower_2)
sortbytype = SortObjectsByType(RhinoObjects=geo_tower_3)  # -> Points, Curves, Surfaces, Breps, Meshes, TextObjects, HatchObjects, LightObjects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
sortbytype_2 = SortObjectsByType(RhinoObjects=geo_midrise_3)  # -> Points, Curves, Surfaces, Breps, Meshes, TextObjects, HatchObjects, LightObjects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
sortbytype_3 = SortObjectsByType(RhinoObjects=geo_row_home_3)  # -> Points, Curves, Surfaces, Breps, Meshes, TextObjects, HatchObjects, LightObjects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
bbox = BoundingBox(Content=geo_row_home_3, Plane=PlaneXY(0, 0, 0), UnionBox=True)  # -> B_Low_Density_Source, B
bbox_2 = BoundingBox(Content=geo_midrise_3, Plane=PlaneXY(0, 0, 0), UnionBox=True)  # -> B_Medium_Density_Source, B
bbox_3 = BoundingBox(Content=geo_tower_3, Plane=PlaneXY(0, 0, 0), UnionBox=True)  # -> B_High_Density_Source, B
dispatch_3 = Dispatch(List=dispatch.ListB, DispatchPattern=smaller_2.SmallerThan)  # -> AMedDensityBox, BHighDensityBox
dispatch_4 = Dispatch(List=dispatch_2.ListB, DispatchPattern=smaller_2.SmallerThan)  # -> ListA, ListB
brep_row_home = Brep(sortbytype_3.Breps)
brep_midrise = Brep(sortbytype_2.Breps)
brep_tower = Brep(sortbytype.Breps)
num_medium_gfa = Number(dispatch_4.ListA)
num_high_gfa = Number(dispatch_4.ListB)
num_low_gfa = Number(dispatch_2.ListA)
num_floor_to_floor_height_3 = Number(num_floor_to_floor_height_2)
num_medium_gfa_2 = Number(num_medium_gfa)
num_high_gfa_2 = Number(num_high_gfa)
num_low_gfa_2 = Number(num_low_gfa)
brep_row_home_2 = Brep(brep_row_home)
brep_tower_2 = Brep(brep_tower)
brep_midrise_2 = Brep(brep_midrise)
morph = BoxMorph(Geometry=brep_midrise_2, Reference=bbox_2.B_Medium_Density_Source, Target=dispatch_3.AMedDensityBox)
morph_2 = BoxMorph(Geometry=brep_row_home_2, Reference=bbox.B_Low_Density_Source, Target=dispatch.ALowDensityBox)
morph_3 = BoxMorph(Geometry=brep_tower_2, Reference=bbox_3.B_High_Density_Source, Target=dispatch_3.BHighDensityBox)
volume = Volume(Geometry=morph_2)  # -> Volume, Centroid
multiplication_4 = Multiplication(A=num_floor_to_floor_height_3, B=num_low_gfa_2)
volume_2 = Volume(Geometry=morph)  # -> Volume, Centroid
multiplication_5 = Multiplication(A=num_floor_to_floor_height_3, B=num_high_gfa_2)
multiplication_6 = Multiplication(A=num_floor_to_floor_height_3, B=num_medium_gfa_2)
volume_3 = Volume(Geometry=morph_3)  # -> Volume, Centroid
ma = MassAddition(Input=volume.Volume)  # -> Result, PartialResults
num_low_volume = Number(multiplication_4)
num_high_volume = Number(multiplication_5)
num_low_volume_2 = Number(multiplication_6)
ma_2 = MassAddition(Input=volume_2.Volume)  # -> Result, PartialResults
ma_3 = MassAddition(Input=volume_3.Volume)  # -> Result, PartialResults
area_2 = Area(Geometry=item_2)  # -> Area, Centroid
division = Division(A=num_low_volume, B=ma.Result)
division_2 = Division(A=num_low_volume_2, B=ma_2.Result)
division_3 = Division(A=num_high_volume, B=ma_3.Result)
scale_nu = ScaleNU(Geometry=morph_2, Plane=area_2.Centroid, ScaleX=1, ScaleY=1, ScaleZ=division)  # -> Geometry, Transform
scale_nu_2 = ScaleNU(Geometry=morph, Plane=area_2.Centroid, ScaleX=1, ScaleY=1, ScaleZ=division_2)  # -> Geometry, Transform
scale_nu_3 = ScaleNU(Geometry=morph_3, Plane=area_2.Centroid, ScaleX=1, ScaleY=1, ScaleZ=division_3)  # -> Geometry, Transform
merge = Merge(Data1=scale_nu.Geometry, Data2=scale_nu_2.Geometry, Data3=scale_nu_3.Geometry)
geometry = Geometry()  # disabled
brep_buildings = Brep(merge)
brep_buildings_2 = ClusterOutput(brep_buildings)

# ==== cluster AirRightsModification
int_density_and_height_culling = ClusterInput()
int_density_and_height_culling_2 = Integer(int_density_and_height_culling)
brep_buildings = ClusterInput()
pt_build_plane = ClusterInput()
brep_buildings_2 = Brep(brep_buildings)
sunion = SolidUnion(Breps=brep_buildings_2)
pt_build_plane_2 = Point(pt_build_plane)
lng = ListLength(List=flatten(sunion))
crv_parcels = ClusterInput()
division = Division(A=lng, B=int_density_and_height_culling_2)
crv_parcels_2 = Curve(crv_parcels)
int = Integer(division)
subtraction = Subtraction(A=lng, B=int)
series = Series(Start=Slider(1, range=0..1), Step=Slider(0, range=0..100), Count=int)
series_2 = Series(Start=Slider(0, range=0..1), Step=Slider(0, range=0..100), Count=subtraction)
merge = Merge(Data1=series, Data2=series_2)
jitter = Jitter(List=merge, Jitter=1, Seed=Slider(10, range=0..10))  # -> Values, Indices
dispatch = Dispatch(List=flatten(sunion), DispatchPattern=jitter.Values)  # -> ListA, ListB
dispatch_2 = Dispatch(List=flatten(crv_parcels_2), DispatchPattern=jitter.Values)  # -> ListA, ListB
scale_nu = ScaleNU(Geometry=dispatch.ListA, Plane=pt_build_plane_2, ScaleX=1, ScaleY=1, ScaleZ=int_density_and_height_culling_2)  # -> Geometry, Transform
brep_buildings_3 = Brep(scale_nu.Geometry)
srf_parks = Brep(dispatch_2.ListB)
srf_parks_2 = ClusterOutput(srf_parks)
brep_buildings_4 = ClusterOutput(brep_buildings_3)

# ==== cluster FootTrafficAnalysisBuildingGen
pt_destination_2 = ClusterInput()
num_analysis_color_sensitivity_upper_bou = ClusterInput()  # "Num: Analysis Color Sensitivity: Upper Bound"
pt_destination_1 = ClusterInput()
pt_destination_3 = ClusterInput()
crv_perimeter_road_analysis_area_bounds = ClusterInput()
num_population = ClusterInput()
num_population_threshold_for_high_traffi = ClusterInput()  # "Num: Population Threshold for 'High Traffic'"
B = ClusterInput()
B_2 = ClusterInput()
num_center_road_offset = ClusterInput()
B_3 = ClusterInput()
brep_buildings = ClusterInput()
B_4 = ClusterInput()
crv_roads = ClusterInput()
pt_destination_2_2 = Point(pt_destination_2)
pt_destination_1_2 = Point(pt_destination_1)
pt_destination_3_2 = Point(pt_destination_3)
num_analysis_color_sensitivity_upper_bou_2 = Number(num_analysis_color_sensitivity_upper_bou)  # "Num: Analysis Color Sensitivity: Upper Bound"
num_center_road_offset_2 = Number(num_center_road_offset)
brep_buildings_2 = Brep(brep_buildings)
merge = Merge(Data1=pt_destination_1_2, Data2=pt_destination_2_2, Data3=pt_destination_3_2)
crv_roads_2 = Curve(crv_roads)
num_population_threshold_for_high_traffi_2 = Number(num_population_threshold_for_high_traffi)  # "Num: Population Threshold for 'High Traffic'"
crv_perimeter_road_analysis_area_bounds_2 = Curve(crv_perimeter_road_analysis_area_bounds)
pt_destination = Point(graft(merge))
lng = ListLength(List=merge)
larger = LargerThan(FirstNumber=num_center_road_offset_2, SecondNumber=0)  # -> LargerThan, OrEqualTo
cull = CullPattern(List=num_center_road_offset_2, CullPattern=larger.LargerThan)

# ---- group: Center Perimeter Path Fix
multiplication = Multiplication(A=cull, B=3)
ext = ExtendCurve(Curve=crv_roads_2, Type=0, Start=multiplication, End=multiplication)
offset = OffsetCurve(Curve=crv_perimeter_road_analysis_area_bounds_2, Distance=cull, Corners=1)
ccx = CurveCurve(CurveA=ext, CurveB=offset)  # -> Points, ParamsA, ParamsB
ccx_2 = CurveCurve(CurveA=ext, CurveB=crv_perimeter_road_analysis_area_bounds_2)  # -> Points, ParamsA, ParamsB
ln = Line(StartPoint=ccx_2.Points, EndPoint=ccx.Points)
crv = Curve(flatten([ln, offset, crv_roads_2]))

# ----
num_population_2 = Number(num_population)
crv_roads_3 = Curve(crv)
bbox = BoundingBox(Content=brep_buildings_2, Plane=PlaneXY(0, 0, 0))  # -> Box, Box_2
volume = Volume(Geometry=bbox.Box)  # -> Volume, Centroid
debrep = DeconstructBrep(Brep=bbox.Box)  # -> Faces, Edges, Vertices
area = Area(Geometry=debrep.Faces)  # -> Area, Centroid
ma = MassAddition(Input=volume.Volume)  # -> Result, PartialResults
pdecon = Deconstruct(Point=area.Centroid)  # -> XComponent, YComponent, ZComponent
division = Division(A=volume.Volume, B=ma.Result)
hilonums = HighestLowestNumbers(Numbers=pdecon.ZComponent)  # -> Highest, Lowest
multiplication_2 = Multiplication(A=num_population_2, B=division)
equals = Equality(FirstNumber=pdecon.ZComponent, SecondNumber=hilonums.Lowest)  # -> Equality, Inequality
round = Round(Number=multiplication_2)  # -> Nearest, Floor, Ceiling
cull_2 = CullPattern(List=debrep.Faces, CullPattern=equals.Equality)
area_2 = Area(Geometry=cull_2)  # -> Area, Centroid
dup = DuplicateData(Data=area_2.Centroid, Number=graft(round.Nearest), Order=True)
crv_roads_4 = Curve(crv_roads_3)
pt_duplicated = Point(flatten(dup))
pt_unduplicated = Point(flatten(area_2.Centroid))
pt_origin = Point(pt_duplicated)

# ---- group: Disconnected (0 Bug Fix)
pt_destination_4 = Point(pt_destination)
pt_origin_and_destination = Point(pt_unduplicated)

# ----
crv_cp = CurveClosestPoint(Point=graft(pt_origin_and_destination), Curve=crv_roads_4)  # -> Point, Parameter, Distance
ln_2 = Line(StartPoint=pt_origin, EndPoint=pt_destination_4)
hilonums_2 = HighestLowestNumbers(Numbers=crv_cp.Distance)  # -> Highest, Lowest
equals_2 = Equality(FirstNumber=crv_cp.Distance, SecondNumber=hilonums_2.Lowest)  # -> Equality, Inequality
cull_3 = CullPattern(List=crv_cp.Point, CullPattern=equals_2.Equality)
ln_3 = Line(StartPoint=flatten(cull_3), EndPoint=pt_origin_and_destination)
crv_2 = Curve(reparameterize([crv_roads_4, ln_3]))
lng_2 = ListLength(List=crv_2)
mcx = MultipleCurves(Curves=crv_2)  # -> Points, IndexA, IndexB, ParamA, ParamB
series = Series(Start=0, Step=1, Count=lng_2)
int = Integer(series)
mindex = MemberIndex(Set=[mcx.IndexA, mcx.IndexB], Member=int)  # -> Index, Count
pshift = ShiftPaths(Data=mindex.Index, Offset=-1)
number_slider = Slider(0.0001, range=1e-05..0.1)
item = ListItem(List=[mcx.ParamA, mcx.ParamB], Index=pshift, Wrap=True)
unflatten = UnflattenTree(Tree=item, Guide=mindex.Index)
cset = CreateSet(List=unflatten)  # -> Set, Map
smaller = SmallerThan(FirstNumber=cset.Set, SecondNumber=number_slider)  # -> SmallerThan, OrEqualTo
larger_2 = LargerThan(FirstNumber=cset.Set, SecondNumber=expr("1-x", number_slider))  # -> LargerThan, OrEqualTo
or = GateOr(A=smaller.SmallerThan, B=larger_2.LargerThan)
cull_4 = CullPattern(List=cset.Set, CullPattern=invert(or))
vb = VBScript(x=cull_4)  # -> out, A
# ---------- vb: VB ----------
    If x Is Nothing Then
      a = nothing
    Else
      a = x
    End If
# ---------- end vb ----------
shatter = Shatter(Curve=graft(crv_2), Parameters=vb.A)  # -> simplify(Segments)

# ---- group: 0 Save Quick Fix
crv_cp_2 = CurveClosestPoint(Point=pt_destination, Curve=flatten(shatter))  # -> Point, Parameter, Distance
hilonums_3 = HighestLowestNumbers(Numbers=crv_cp_2.Distance)  # -> Highest, Lowest
equals_3 = Equality(FirstNumber=crv_cp_2.Distance, SecondNumber=hilonums_3.Lowest)  # -> Equality, Inequality
cull_5 = CullPattern(List=crv_cp_2.Point, CullPattern=equals_3.Equality)
ln_4 = Line(StartPoint=pt_destination, EndPoint=cull_5)
dupln = RemoveDuplicateLines(Lines=ln_4, Tolerance=0.01)

# ----
crv_all_streets_exploded = Curve([shatter, dupln])
len = Length(Curve=flatten(crv_all_streets_exploded))
shortwalk = ShortestWalk(Curves=flatten(crv_all_streets_exploded), WantedPath=ln_2)  # -> ShortestWalk, Succession, Direction, Length
topoly = CurveToPolyline(Curve=shortwalk.ShortestWalk, ToleranceDistance=0, ToleranceAngle=0)  # -> Polyline, Segments
explode = Explode(Curve=topoly.Polyline, Recursive=True)  # -> flatten(Segments), Vertices
line_building_connection_to_streets = Line(ln_3)
len_2 = Length(Curve=dupln)
ma_2 = MassAddition(Input=flatten(len_2))  # -> Result, PartialResults
rdlines = RemoveDuplicateLinesKaramba3D(Line=explode.Segments, LimitDistance=0.005)  # -> OutLine, Info, Indexes
item_2 = ListItem(List=explode.Segments, Index=rdlines.Indexes, Wrap=True)
curvepoint = PointOnCurve(rdlines.OutLine, parameter=0.5)
curvepoint_2 = PointOnCurve(item_2, parameter=0.5)
cir = Circle(Plane=curvepoint, Radius=1)
incurve = PointInCurve(Point=curvepoint_2, Curve=graft(cir))  # -> Relationship, Point
ma_3 = MassAddition(Input=incurve.Relationship)  # -> Result, PartialResults
division_2 = Division(A=ma_3.Result, B=2)  # -> flatten(Result)
num_analysis_sensitivity = Number(num_analysis_color_sensitivity_upper_bou_2)
hilonums_4 = HighestLowestNumbers(Numbers=division_2)  # -> Highest, Lowest
division_3 = Division(A=hilonums_4.Highest, B=num_analysis_sensitivity)
num_total_lengths_analysis = Number(Slider(25, range=0..100))
gradient = Gradient(
    LowerLimit=hilonums_4.Lowest,
    UpperLimit=num_analysis_sensitivity,
    Parameter=division_2,
    stops=[0: RGB(75, 107, 169), 0.254: RGB(173, 203, 249), 0.5: RGB(254, 244, 84), 0.748: RGB(234, 126, 0), 1: RGB(234, 38, 0)])
multiplication_3 = Multiplication(A=num_total_lengths_analysis, B=0.01)
multiplication_4 = Multiplication(A=multiplication_3, B=num_population_2)
Z = UnitZ(Factor=division_2)
larger_3 = LargerThan(FirstNumber=division_2, SecondNumber=num_population_threshold_for_high_traffi_2)  # -> LargerThan, OrEqualTo
extr = Extrude(Base=rdlines.OutLine, Direction=Z)
cull_6 = CullPattern(List=rdlines.OutLine, CullPattern=larger_3.LargerThan)
curvepoint_3 = PointOnCurve(cull_6, parameter=0.5)
curvepoint_4 = PointOnCurve(dupln, parameter=0.5)
preview = CustomPreview(Geometry=extr, Material=gradient)
previewlw = CustomPreviewLineweights(Geometry=flatten(rdlines.OutLine), Shader=gradient, Thickness=Slider(10, range=0..100), Absolute=False)
len_3 = Length(Curve=cull_6)
cir_2 = Circle(Plane=curvepoint_3, Radius=1)
cull_7 = CullPattern(List=division_2, CullPattern=larger_3.LargerThan)
panel = Panel(cull_7)
ma_4 = MassAddition(Input=len_3)  # -> Result, PartialResults
incurve_2 = PointInCurve(Point=flatten(curvepoint_4), Curve=graft(cir_2))  # -> Relationship, Point

# ---- group: Remove Destination Lines to Perimeter
subtraction = Subtraction(A=ma_4.Result, B=ma_2.Result)

# ----
ma_5 = MassAddition(Input=len)  # -> Result, PartialResults
int_2 = Integer(subtraction)
num_total_length_of_streets_with_25_foot = Number(int_2)  # "Num: Total Length of Streets with 25%+ Foot Traffic (ft)"
total_desirable_storefront_street_length = Panel(num_total_length_of_streets_with_25_foot)  # "Total Desirable Storefront Street Length (ft)"
ma_6 = MassAddition(Input=incurve_2.Relationship)  # -> flatten(Result), PartialResults
subtraction_2 = Subtraction(A=ma_5.Result, B=ma_2.Result)
cull_8 = CullPattern(List=cull_7, CullPattern=invert(ma_6.Result))
cull_9 = CullPattern(List=cull_6, CullPattern=invert(ma_6.Result))
curvepoint_5 = PointOnCurve(cull_9, parameter=0.5)
division_4 = Division(A=num_total_length_of_streets_with_25_foot, B=subtraction_2)
num_per_street_foot_traffic = Number(division_2)
debrep_2 = DeconstructBrep(Brep=B_3)  # -> Faces, Edges, Vertices
multiplication_5 = Multiplication(A=division_4, B=100)
Z_2 = UnitZ(Factor=cull_8)
crv_street_segments_above_threshold = Curve(cull_9)
move = Move(Geometry=curvepoint_5, Motion=Z_2)  # -> Geometry, Transform
roundd = RoundToDecimalPlace(NumberX=multiplication_5, DecimalPlace=2, RoundType=0)  # -> Rounded, Difference
screentext = ScreenOrientedText(
    Text=cull_8,
    Justification=5,
    Location=move.Geometry,
    SizeFactor=Slider(15, range=0..100),
    Depth=0,
    Absolute=Toggle(True))
num_people_per_street_segment_above_thre = Number(cull_8)  # "Num: People per Street Segment Above Threshold"
col_analysis_color = Colour(gradient)
pt_point_to_display_people_number_for_se = Point(move.Geometry)  # "Pt: Point to Display People Number for Segments"
num_percentage_of_streets_above_threshol = Number(roundd.Rounded)  # "Num: Percentage of Streets Above Threshold"
num_per_street_foot_traffic_2 = Number(num_per_street_foot_traffic)
srf_analysis_extrusions = Surface(extr)
num_per_street_foot_traffic_3 = Number(num_per_street_foot_traffic)
multiplication_6 = Multiplication(A=cull, B=2)
crv_street_segments_above_threshold_2 = Curve(crv_street_segments_above_threshold)
offcrv = OffsetCurve(
    Curve=debrep_2.Edges,
    Plane=PlaneXY(0, 0, 0),
    Distance=multiplication_6,
    BothSides=0,
    Kinks=0,
    CapType=Slider(1, range=0..1))  # -> flatten(Offset)
curvepoint_6 = PointOnCurve(crv_street_segments_above_threshold_2, parameter=0.5)
number_slider_2 = Slider(35, range=0..100)
addition = Addition()
neg = Negative(Value=number_slider_2)
ln_5 = Line(StartPoint=curvepoint_6, EndPoint=move.Geometry)
incurves = PointInCurves(Point=curvepoint_6, Curves=graft(offcrv))  # -> Relationship, Index, Point
len_4 = Length(Curve=ln_5)
ma_7 = MassAddition(Input=incurves.Relationship)  # -> Result, PartialResults
equals_4 = Equality(FirstNumber=ma_7.Result, SecondNumber=0)  # -> flatten(Equality), Inequality
cull_10 = CullPattern(List=flatten(debrep_2.Edges), CullPattern=flatten(equals_4.Inequality))
hilonums_5 = HighestLowestNumbers(Numbers=num_per_street_foot_traffic_3)  # -> Highest, Lowest
previewlw_2 = CustomPreviewLineweights(
    Geometry=cull_10,
    Shader={diffuse=RGB(255, 105, 180), emission=RGB(76, 32, 54), shine=0.5, specular=RGB(255, 255, 255), transparency=0},
    Thickness=Slider(10, range=0..10),
    Absolute=False)
srf_analysis_extrusions_2 = Surface(extr)
offsrf = OffsetSurface(Surface=srf_analysis_extrusions_2, Distance=Slider(1, range=0..10), BothSides=0, CreateSolid=True)
Z_3 = UnitZ(Factor=hilonums_5.Highest)
dup_2 = DuplicateData(Data=curvepoint_6, Number=len_4, Order=True)
offsrf_2 = OffsetSurface(Surface=srf_analysis_extrusions_2, Distance=graft([number_slider_2, neg]), BothSides=0, CreateSolid=True)  # -> flatten(Offset)
extr_2 = Extrude(Base=cull_10, Direction=Z_3)
bbx = BrepBrep(BrepA=offsrf_2, BrepB=graft(extr_2))  # -> Curves, Points
boundary = BoundarySurfaces(Edges=bbx.Curves)  # -> flatten(Surfaces)
clean = CleanTree(RemoveNulls=True, RemoveInvalid=True, RemoveEmpty=False, Tree=boundary)
debrep_3 = DeconstructBrep(Brep=clean)  # -> Faces, Edges, Vertices
curvepoint_7 = PointOnCurve(debrep_3.Edges, parameter=0.5)
len_5 = Length(Curve=debrep_3.Edges)
hilonums_6 = HighestLowestNumbers(Numbers=len_5)  # -> Highest, Lowest
pdecon_2 = Deconstruct(Point=curvepoint_7)  # -> XComponent, YComponent, ZComponent
int_3 = Integer(flatten(hilonums_6.Highest))
hilonums_7 = HighestLowestNumbers(Numbers=pdecon_2.ZComponent)  # -> Highest, Lowest
equals_5 = Equality(FirstNumber=pdecon_2.ZComponent, SecondNumber=hilonums_7.Lowest)  # -> Equality, Inequality
cull_11 = CullPattern(List=debrep_3.Edges, CullPattern=equals_5.Equality)  # -> flatten(List)
crv_analysis_area = Curve(crv_perimeter_road_analysis_area_bounds)
division_5 = Division(A=int_3, B=B)
Z_4 = UnitZ(Factor=division_5)
extr_3 = Extrude(Base=cull_11, Direction=flatten(Z_4))
division_6 = Division(A=int_3, B=B_2)
neg_2 = Negative(Value=division_6)
Z_5 = UnitZ(Factor=1000)
offsrf_3 = OffsetSurface(Surface=extr_3, Distance=division_6, BothSides=neg_2, CreateSolid=True)
extr_4 = Extrude(Base=B_4, Direction=Z_5)
multiplication_7 = Multiplication(A=cull, B=10)
multiplication_8 = Multiplication(A=num_population_2, B=lng)
offset_2 = OffsetCurve(Curve=crv_analysis_area, Distance=multiplication_7, Corners=1)
Z_6 = UnitZ(Factor=multiplication_8)
extr_5 = Extrude(Base=offset_2, Direction=Z_6)
extr_6 = Extrude(Base=crv_analysis_area, Direction=Z_6)
cap = CapHoles(Brep=extr_5)
cap_2 = CapHoles(Brep=extr_6)
sdiff = SolidDifference(BrepsA=cap, BrepsB=cap_2)
sunion = SolidUnion(Breps=flatten([extr_4, sdiff]))
sdiff_2 = SolidDifference(BrepsA=offsrf_3, BrepsB=sunion)  # -> flatten(Result)
preview_2 = CustomPreview(Geometry=sdiff_2, Material=ColourSwatch(SwatchColor=RGB(130, 114, 114)))
num_per_street_foot_traffic_4 = ClusterOutput(num_per_street_foot_traffic_3)
num_percentage_of_streets_above_threshol_2 = ClusterOutput(num_percentage_of_streets_above_threshol)  # "Num: Percentage of Streets Above Threshold"
O = ClusterOutput(offsrf)
num_people_per_street_segment_above_thre_2 = ClusterOutput(num_people_per_street_segment_above_thre)  # "Num: People per Street Segment Above Threshold"
R = ClusterOutput(sdiff_2)
col_analysis_color_2 = ClusterOutput(col_analysis_color)
pt_point_to_display_people_number_for_se_2 = ClusterOutput(pt_point_to_display_people_number_for_se)  # "Pt: Point to Display People Number for Segments"
